# Grasshopper definition analysisRecipe.gh (Grasshopper 0.9.76)
# plug-ins: Python Interpreter

# from honeybeegrasshopper.radiance import radianceparameters
# 
# if _quality:
#     radParameters = radianceparameters.RadianceParameters(_quality)
#     if _ab_: radParameters.ab = _ab_
#     if _ad_: radParameters.ad = _ad_
#     if _as_: radParameters.as_ = _as_
#     if _ar_: radParameters.ar = _ar_
#     if _aa_: radParameters.aa = _aa_
number_slider = Slider(2, range=0..10)
# from honeybeegrasshopper.radiance import sky
# 
# if _illuminanceValue:
#     HBSky = sky.HBCertainIlluminanceLevelSky(_illuminanceValue)
number_slider_2 = Slider(200, range=0..1000)
planesrf = PlaneSurface(Plane=PlaneXY(0, 0, 0), XSize="20", YSize="20")

# ---- group: Radiance parameters
radpar = PythonScript(quality=number_slider)  # -> radParameters; inputs quality: Int32, ab: Int32, ad: Int32, as: Int32, ar: Int32
# ---------- radpar: Python ----------
import sys
sys.path.append(r"C:\Users\Administrator\Documents\GitHub\honeybee-grasshopper")

from honeybeegrasshopper.radiance import parameters
from honeybeegrasshopper import wrapper

if _quality:
    radParameters = parameters.RadianceParameters(_quality)
    if _ab_: radParameters.ab = _ab_
    if _ad_: radParameters.ad = _ad_
    if _as_: radParameters.as_ = _as_
    if _ar_: radParameters.ar = _ar_
    if _aa_: radParameters.aa = _aa_
    
    #print radParameters
    #wrap the object
    radParameters = wrapper.Wrapper(radParameters)
# ---------- end radpar ----------

# ----
number_slider_3 = Slider(20, range=0..100)

# ---- group: sky library
sky = PythonScript(illuminanceValue=number_slider_2)  # -> HBSky
# ---------- sky: Python ----------
import sys
sys.path.append(r"C:\Users\Administrator\Documents\GitHub\honeybee-grasshopper")

from honeybeegrasshopper.radiance.sky.certainIlluminance import SkyWithCertainIlluminanceLevel
from honeybeegrasshopper.wrapper import Wrapper
if _illuminanceValue:
    HBSky = Wrapper(SkyWithCertainIlluminanceLevel(_illuminanceValue))
# ---------- end sky ----------

# ----
python = PythonScript(name="wall", reflect=".55", spec=0, rough=0)  # -> material
# ---------- python: Python ----------
import sys
sys.path.append(r"C:\Users\Administrator\Documents\GitHub\honeybee-grasshopper")

from honeybeegrasshopper.radiance.material.plastic import PlasticMaterial
from honeybeegrasshopper.wrapper import Wrapper

if _name and _reflect:
    material = PlasticMaterial.bySingleReflectValue(_name, _reflect, _spec_, _rough_)
    
    material = Wrapper(material)
# ---------- end python ----------
panel = Panel(python)
sdivide = DivideSurface(Surface=planesrf, UCount=number_slider_3, VCount=number_slider_3)  # -> Points, Normals, Parameters
# from honeybeegrasshopper.radiance import analysisrecipe, sky
# 
# if _skyFile and _testPoints and ptsVectors_:
#     analysisRecipe = analysisrecipe.GridBasedAnalysisRecipe(_skyFile, \
#         _testPoints, ptsVectors_, _radParameters_)
panel_2 = Panel(radpar)
panel_3 = Panel(sky)

# ---- group: analysis recipe
gridbased = PythonScript(HBSky=sky, testPoints=sdivide.Points, radParameters=radpar)  # -> analysisRecipe; inputs testPoints: tree of Point3d, ptsVectors: tree of Vector3d
# ---------- gridbased: Python ----------
import sys
sys.path.append(r"C:\Users\Administrator\Documents\GitHub\honeybee-grasshopper")

from honeybeegrasshopper.radiance.analysisrecipe import GridBasedAnalysisRecipe
from honeybeegrasshopper import wrapper

if _HBSky and _testPoints and ptsVectors_:
    if _radParameters_:
        _radParameters_ = _radParameters_.unwrap()
    
    analysisRecipe = GridBasedAnalysisRecipe(
        _HBSky.unwrap(), _testPoints, ptsVectors_, _radParameters_
        )
    
    analysisRecipe = wrapper.Wrapper(analysisRecipe)
# ---------- end gridbased ----------

# ----
python_2 = PythonScript(material=python)  # -> radProp
# ---------- python_2: Python ----------
import sys
sys.path.append(r"C:\Users\Administrator\Documents\GitHub\honeybee-grasshopper")

from honeybeegrasshopper.radiance.properties import RadianceProperties
from honeybeegrasshopper.wrapper import Wrapper

radProp = RadianceProperties(_material_.unwrap(), True) if _material_ else RadianceProperties()
radProp = Wrapper(radProp)
# ---------- end python_2 ----------
panel_4 = Panel(python_2)
python_3 = PythonScript(_geo=planesrf, RadProp_=python_2)  # -> ReadMe, HBSurface
panel_5 = Panel(gridbased)
